# Grasshopper definition indoor_and_outdoor_prototype.gh (Grasshopper 0.9.76)
# plug-ins: Python Interpreter, Human

# ---- group: I don't know what to call these
epsilonwallfunction = Butterfly_epsilonWallFunction(Cmu=0.09, kappa=0.4, E=9.8)  # -> epsilonWallFunction; plug-in component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
nutkwallfunction = Butterfly_nutkW4allFunction()  # -> nutkWallFunction; plug-in component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
kqrwallfunction = Butterfly_kqRWallFunction(value="0.01")  # -> kqRWallFunction; plug-in component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
fixedvalue = Butterfly_fixedValue(value="(0 0 0)")  # -> fixedValue; plug-in component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
calculated = Butterfly_calculated()  # -> calculated; plug-in component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
zerogradient = Butterfly_zeroGradient()  # -> zeroGradient; plug-in component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

# ----
panel = Panel(nutkwallfunction)

# ---- group: create your own
boundary = Butterfly_Boundary(bType="patch", U=zerogradient, p=zerogradient, k=zerogradient, epsilon=calculated, nut=calculated)  # -> readMe, boundary; plug-in component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

# ----
# Download and load butterfly!
panel_2 = Panel("C:\Users\Administrator\Documents\GitHub\Butterfly")
toggle = BooleanToggle(False)
wall = PythonScript(refLevels="(1, 2)")  # -> wallBC
# ---------- wall: Python ----------
from butterfly import boundarycondition
wallBC = boundarycondition.IndoorWallBoundaryCondition(refLevels=_refLevels_)
# ---------- end wall ----------
vec = VectorXYZ(XComponent="2", YComponent=0, ZComponent=0)  # -> Vector, Length
loadprobesfromproject = Butterfly_LoadProbesFromProject(name="indoor_temperature", field="T")  # -> values; plug-in component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

# ---- group: downloads and installs butterfly if it's not already installed!
butterfly = Butterfly(butterflyFolder=panel_2)  # -> swooooosh; "BF::BF"; plug-in component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

# ----
panel_3 = Panel("{3,1,2}")
# 0. Create BF surface
brep = Brep([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])
# 1. Wind Tunnel Parameters
jagged = SettingsSpeed()
inlet = Butterfly_InletBoundary(velocityVec=vec.Vector, refLevels="(5, 5)")  # -> inletBoundary; plug-in component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
panel_4 = Panel(loadprobesfromproject)
wall_2 = Butterfly_WallBoundary(refLevels="(1, 5)")  # -> wallBoundary; plug-in component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
outlet = Butterfly_OutletBoundary(refLevels="(5, 5)")  # -> outletBoundary; plug-in component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
createbfsurface = Butterfly_CreateButterflySurface(geo=brep, name="buildings", boundary=wall, meshSet=jagged)  # -> readMe, BFSrf; plug-in component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
# Outdoor Study
preview = CustomPreview(
    Geometry=brep,
    Shader={ambient=RGB(0, 0, 0), diffuse=RGB(255, 105, 180), emission=RGB(76, 32, 54), shine=0.5, specular=RGB(255, 255, 255), transparency=0})
windtunnelpar = Butterfly_WindTunnelParameters(windwardX=3, topX=3, sidesX=2, leewardX=15, nDivXYZ="{30,5,10}")  # -> readMe, tunnelPar; plug-in component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
panel_5 = Panel(butterfly)
number_slider = Slider(1, range=0..1)
number_slider_2 = Slider(20, range=0..100)

inoutrefmode = Butterfly_LocationRefinementMode(mode=0, level=Slider(5, range=0..10))  # -> locationRefMode; plug-in component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
brep_2 = Brep(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)
jagged_2 = SettingsSpeed()
panel_6 = Panel(inoutrefmode)
refinementregion = Butterfly_RefinementRegion(geo=flatten(brep_2), name="ref_001", refMode=inoutrefmode, meshSet=jagged_2)  # -> readMe, refinementRegion; plug-in component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

brep_3 = Brep(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)
panel_7 = Panel("(1, 6)")

# ---- group: inlet!
srf = Surface(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)

# ----
jagged_3 = SettingsSpeed()
srf_2 = Surface(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)
number_slider_3 = Slider(10, range=0..10)
vec_2 = Vector(Vector(47.94345108, 59.67856447, 0))
wires = BrepWireframe(Brep=brep_3, Density=-1)
# Indoor Study
area = Area(Geometry=srf)  # -> Area, Centroid
distrefmode = Butterfly_DistanceRefinementMode(levels_0="(1, 5)", levels_1="(2, 3)")  # -> distanceRefMode; plug-in component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
# Refinement Region
panel_8 = Panel("{1,1,1}")
# 2. Create the Wind Tunnel
panel_9 = Panel("6.0")
vdis = VectorDisplay(Anchor=Point(0, 0, 0), Vector=vec_2)
preview_2 = CustomPreview(Geometry=[srf_2, srf], Shader=ColourSwatch(SwatchColor=RGBA(136, 191, 255, 77)))
# 0. Create BF surfaces
vdis_2 = VectorDisplay(Anchor=area.Centroid, Vector=vec.Vector)
box = DomainBox(Base=PlaneXY(0, 0, 0), X=number_slider_3, Y=number_slider_3, Z=number_slider_3)
createcasefromtunnel = Butterfly_CreateCaseFromTunnel(
    name="outdoor_t_1",
    BFSurfaces=createbfsurface.BFSrf,
    windSpeed=panel_9,
    refWindHeight=10,
    landscape=1,
    tunnelPar=windtunnelpar.tunnelPar,
    run=Toggle(False))  # -> readMe, geo, case; plug-in component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
panel_10 = Panel(distrefmode)
wires_2 = BrepWireframe(Brep=brep_2, Density=-1)
blockmeshdict = Butterfly_blockMeshDict(bbox=box, nDivXYZ="{4,4,4}", gradXYZ=panel_8)  # -> blockMeshDict; plug-in component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
createbfsurface_2 = Butterfly_CreateButterflySurface(geo=flatten(srf_2), name="east_window", boundary=outlet, meshSet=jagged_3)  # -> readMe, BFSrf; plug-in component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
createbfsurface_3 = Butterfly_CreateButterflySurface(geo=brep_3, name="room", boundary=wall_2, meshSet=jagged_3)  # -> readMe, BFSrf; plug-in component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
createbfsurface_4 = Butterfly_CreateButterflySurface(geo=srf, name="west_window", boundary=inlet, meshSet=jagged_3)  # -> readMe, BFSrf; plug-in component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
panel_11 = Panel(createcasefromtunnel.readMe)
previewlw = CustomPreviewLineweights(
    Geometry=wires_2,
    Shader={ambient=RGB(0, 0, 0), diffuse=RGB(255, 105, 180), emission=RGB(76, 32, 54), shine=0.5, specular=RGB(255, 255, 255), transparency=0},
    Thickness=Slider(3, range=0..10),
    Absolute=False)
python = PythonScript()  # -> out, a; unedited script template
# 1. Create an OpenFOAM case
panel_12 = Panel("indoor_airflow_b")
panel_13 = Panel("C:\Users\Administrator\Documents\GitHub\Butterfly")
dom = ConstructDomain(DomainStart="1", DomainEnd="2")
loadprobesfromproject_2 = Butterfly_LoadProbesFromProject()  # -> values; plug-in component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

# ---- group: Create and write the case!
createcasefromsurfaces = Butterfly_CreateCaseFromSurfaces(
    name=panel_12,
    BFSurfaces=flatten([createbfsurface_3.BFSrf, createbfsurface_4.BFSrf, createbfsurface_2.BFSrf]),
    blockMeshDict=blockmeshdict,
    globalRefLevel=dom,
    run=Toggle(True))  # -> readMe, case; plug-in component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

# ----
pt = Point([Point(1.933395533, 5.160314456, 1.966949468), Point(7.958785718, 6.157761352, 2.624808354)])
panel_14 = Panel(pt)
toggle_2 = BooleanToggle(False)
# purgeCase
purgecase = Butterfly_purgeCase(case=createcasefromsurfaces.case, blockMesh=toggle_2, snappyHexMesh=toggle_2, results=toggle_2)  # -> readMe; plug-in component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

# ----
# 0. blockMesh
# 1. snappyHexMesh
# 1.2. update fvSchemes based on
# mesh orthogonality
# 1.1. checkMesh
toggle_3 = BooleanToggle(True)
snappyhexmeshdict = Butterfly_snappyHexMeshDict(castellatedMesh=True, snap=True, addLayers=False, maxGlobalCells=2000000)  # -> snappyHexMeshDict; plug-in component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
blockmesh = Butterfly_blockMesh(case=createcasefromsurfaces.case, purge=Toggle(True), run=toggle_3)  # -> readMe, case; plug-in component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
# Meshing!
snappyhexmesh = Butterfly_snappyHexMesh(case=blockmesh.case, run=Toggle(False))  # -> out, case; plug-in component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
chekmesh = Butterfly_chekMesh(case=snappyhexmesh.case, run=Toggle(False))  # -> readMe, case, maxNonOrthogonality; plug-in component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
updatefvschemes = Butterfly_UpdateFvSchemes(case=chekmesh.case, orthogonality=chekmesh.maxNonOrthogonality, run=Toggle(True))  # -> readMe, case; plug-in component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

brep_4 = Brep([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])
python_2 = PythonScript(geo=brep_4, nDivXYZ="{1,1,1}", gradXYZ="{1,1,1}")  # -> out, block; inputs geo: Brep, nDivXYZ: Point3d, gradXYZ: Point3d; disabled
# ---------- python_2: Python ----------
import sys
sys.path.append("C:/Users/Administrator/Dropbox/ladybug/Butterfly")

import butterfly
from butterfly.gh import Block

reload(butterfly)
reload(butterfly.gh)

block = Block(geo, nDivXYZ, gradXYZ)
# ---------- end python_2 ----------
wires_3 = BrepWireframe(Brep=brep_4, Density=-1)
python_3 = PythonScript(name="innerflow_2", blocks=python_2.block)  # -> out, c; inputs BFSrfs: list, blocks: list; disabled
# ---------- python_3: Python ----------
import sys
sys.path.append("C:/Users/Administrator/Dropbox/ladybug/Butterfly")

import butterfly
from butterfly.foamfile import FoamFile
from butterfly.core import Case

reload(butterfly)
reload(butterfly.blockMeshDict)
reload(butterfly.foamfile)
reload(butterfly.core)

c = Case.fromBlocks(BFSrfs, blocks, 1)
c.write(name)
# ---------- end python_3 ----------
panel_15 = Panel(python_3.out)

# ---- group: case
# Load mesh,
# points, results
data = Data(blockmesh.case)

# ----
panel_16 = Panel(chekmesh.readMe)
loadpoints = Butterfly_LoadPoints(case=data, load=Toggle(False))  # -> pts; plug-in component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
loadmesh = Butterfly_LoadMesh(case=data, load=Toggle(True))  # -> mesh; plug-in component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
brep_5 = Brep([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])
item = ListItem(List=brep_5, Index=0, Wrap=True)
pt_2 = Point(<point referenced from the Rhino model>)
pt_3 = Point(<point referenced from the Rhino model>)
gentestpts = Honeybee_GenerateTestPoints(testGeometry=brep_5, gridSize=Slider(0.5, range=0..1), distBaseSrf="0.05", moveTestMesh=Toggle(False))  # -> readMe, simplify(testPoints), simplify(ptsVectors), simplify(facesArea), simplify(mesh); plug-in component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
xy = XYPlane(Origin=pt_2)
xz = XZPlane(Origin=pt_3)
sec = MeshPlane(Plane=[xz, xy])
panel_17 = Panel("C:\Users\Administrator\butterfly\atrium2d\3\polyMesh")

panel_18 = Panel("C:\Users\Administrator\Dropbox\ladybug\Butterfly\other_files\OpenFOAM_Sample_Files\innerflow\constant\polyMesh")
python_4 = PythonScript()  # -> out, mesh
# ---------- python_4: Python ----------
import Rhino as rc
import os

def splitLine(l, t=float):
    return tuple(t(s) for s in l.split('(')[-1].replace(')', '').split())

def OFMeshToRhino(studyFolder):
    if not studyFolder:
        return

    pf = os.path.join(studyFolder, 'points')
    ff = os.path.join(studyFolder, 'faces')
    
    if not os.path.isfile(pf) or not os.path.isfile(ff):
        print "Can't find point and faces file."
        return
        
    # read points
    with open(pf, 'rb') as ptFile:
        for l in xrange(17):
            ptFile.readline()
        
        try:
            # blockMesh
            line = ptFile.readline()
            nPoints = int(line[0])
            pts = tuple(
                       rc.Geometry.Point3d(*pt)
                       for pt in eval(line[1:].replace(" ", ", "))
                       )
        except:
            #snappyHexMesh
            line = ptFile.readline()
            nPoints = int(line)
            ptFile.readline()
            pts = tuple(
                       rc.Geometry.Point3d(*splitLine(ptFile.readline()))
                       for pt in xrange(nPoints)
                )

            
    # read faces
    with open(ff, 'rb') as faceFile:
       for l in xrange(18):
           faceFile.readline()
       
       nFaces = int(faceFile.readline())
       faceFile.readline()
       faces = tuple((splitLine(faceFile.readline(), t=int))
                   for pt in xrange(nFaces)
            )
    
    # create the mesh
    mesh = rc.Geometry.Mesh()

    for p in pts:
        mesh.Vertices.Add(p)

    for face in faces:
        if len(face) < 5:
            mesh.Faces.AddFace(*face)
        elif len(face) == 5:
            mesh.Faces.AddFace(*face[:3])
            mesh.Faces.AddFace(*face[:1] + (face[3:]))
        elif len(face) == 8:
            mesh.Faces.AddFace(*face[:4])
            mesh.Faces.AddFace(*(face[0], face[3], face[4], face[7]))
            mesh.Faces.AddFace(*(face[7], face[4], face[5], face[6]))
        else:
            try:
                mesh.Faces.AddFace(*face[:4])
                mesh.Faces.AddFace(*face[:1] + (face[4:]))
            except:
                msg = "One of the faces has %d vertices." % len(face)
                print msg

    return mesh

mesh = OFMeshToRhino(studyFolder)
# ---------- end python_4 ----------
pt_4 = Point(Point(5.246792205, 3.706414975, 3.184472171))
xz_2 = XZPlane(Origin=pt_4)
xy_2 = XYPlane(Origin=pt_4)
yz = YZPlane(Origin=pt_4)
mesh = Mesh(python_4.mesh)
sec_2 = MeshPlane(Mesh=mesh, Plane=xy_2)

panel_19 = Panel("C:\Users\Administrator\butterfly\innerflow_3\constant\polyMesh")

les = Butterfly_LESTurbulanceModel(LESModel="kEqn", delta="cubeRootVol", turbulence=True, printCoeffs=True)  # -> LES; plug-in component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
ras = Butterfly_RASTurbulanceModel(RASModel="RNGkEpsilon", turbulence=True, printCoeffs=True)  # -> RAS; plug-in component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
leminar = Butterfly_LaminarTurbulanceModel()  # -> laminar; plug-in component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

flatten = FlattenTree(Tree=gentestpts.testPoints, Path="{0}")
faceb = FaceBoundaries(Mesh=gentestpts.mesh)
number_slider_4 = Slider(50, range=0..100)
number_slider_5 = Slider(50, range=0..100)
number_slider_6 = Slider(25, range=0..100)
panel_20 = Panel("""U
p""")

# ---- group: recipe
steadyincomp = Butterfly_SteadyIncompressibleRecipe(case=blockmesh.case, turbulenceProp=ras)  # -> readMe, recipe; plug-in component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

# ----
controldict = Butterfly_controlDict(startTime=0, endTime=Slider(20, range=0..100), writeInterval=Slider(10, range=0..10), writeCompression=Toggle(False))  # -> controlDict; plug-in component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
residualcontrol = Butterfly_residualControl(p="0.00001", U="0.00001", k="0.00001", epsilon="0.00001")  # -> residualControl; plug-in component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
probes = Butterfly_probes(pts=flatten, fields=panel_20)  # -> probes; plug-in component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
panel_21 = Panel("C:\Users\Administrator\butterfly\indoor_airflow_3\constant\polyMesh")
panel_22 = Panel("C:\Users\Administrator\butterfly\indoor_airflow_3\1900")
panel_23 = Panel("residualControl::p > 20")

# ---- group: runtime editable parameters
solutionparams = Butterfly_SolutionParameters(controlDict=controldict, residualControl=residualcontrol, probes=probes)  # -> readMe, solutionParams; plug-in component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

# ----
panel_24 = Panel("C:\Users\Administrator\Documents\GitHub\Butterfly\plugin\grasshopper")
panel_25 = Panel(solutionparams.solutionParams)
python_5 = PythonScript()  # -> vectors
# ---------- python_5: Python ----------
import Rhino as rc
import os

def splitLine(l, t=float):
    return tuple(t(s) for s in l.split('(')[-1].replace(')', '').split())


def loadVectors(studyFolder):
    pf = os.path.join(studyFolder, 'U')
    
    if not os.path.isfile(pf):
        print "Can't find vector file."
        return
        
    # read vectors
    with open(pf, 'rb') as ptFile:
        for l in xrange(21):
            line = ptFile.readline()       
        nVectors = int(line)
        ptFile.readline()
        vectors = tuple(
                   rc.Geometry.Vector3d(*splitLine(ptFile.readline()))
                   for pt in xrange(nVectors)
            )
    return vectors

vectors = loadVectors(studyFolder)
# ---------- end python_5 ----------
python_6 = PythonScript()  # -> pts
# ---------- python_6: Python ----------
import Rhino as rc
import os

def splitLine(l, t=float):
    return tuple(t(s) for s in l.split('(')[-1].replace(')', '').split())


def loadPoints(studyFolder):
    pf = os.path.join(studyFolder, 'points')
    
    if not os.path.isfile(pf):
        print "Can't find point and faces file."
        return
        
    # read points
    with open(pf, 'rb') as ptFile:
        for l in xrange(17):
            ptFile.readline()
        
        try:
            # blockMesh
            line = ptFile.readline()
            nPoints = int(line[0])
            pts = tuple(
                       rc.Geometry.Point3d(*pt)
                       for pt in eval(line[1:].replace(" ", ", "))
                       )
        except:
            #snappyHexMesh
            line = ptFile.readline()
            nPoints = int(line)
            ptFile.readline()
            pts = tuple(
                       rc.Geometry.Point3d(*splitLine(ptFile.readline()))
                       for pt in xrange(nPoints)
                )

    return pts

pts = loadPoints(studyFolder)
# ---------- end python_6 ----------
exportladybug = Ladybug_ExportLadybug(targetFolder=panel_24, export=Toggle(False))  # -> readMe; plug-in component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
solution = Butterfly_Solution(
    recipe=steadyincomp.recipe,
    solutionParams=solutionparams.solutionParams,
    interval=Slider(1, range=0..1),
    write=Toggle(True),
    run=Toggle(False))  # -> readMe, solution, status, logFile; plug-in component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
panel_26 = Panel(exportladybug)
panel_27 = Panel(solution.status)

# ---- group: dynamic outputs
python_7 = PythonScript()  # -> out; inputs x: list
# ---------- python_7: Python ----------
import Grasshopper.Kernel as gh

def addOutputParam(name, description):
    param = gh.Parameters.Param_ScriptVariable()
    param.NickName = name
    param.Name = name
    param.Description = description
    # param.AddVolatileData(path, 0, value)
    # param.AddVolatileDataList(path, [1, 2, 3, 4])
    index = ghenv.Component.Params.Output.Count
    ghenv.Component.Params.RegisterOutputParam(param, index)
    ghenv.Component.Params.OnParametersChanged()

def removeOutputs():
    
    if ghenv.Component.Params.Output.Count == 1:
        return
        
    while ghenv.Component.Params.Output.Count > 1:
        p = ghenv.Component.Params.Output[ghenv.Component.Params.Output.Count - 1]
        ghenv.Component.Params.UnregisterOutputParameter(p)
    
    ghenv.Component.Params.OnParametersChanged()
    ghenv.Component.ExpireSolution(True)
    

if x:
#    removeOutputs()
    
    for i in x:
        addOutputParam(str(i), str(i))
        
elif ghenv.Component.Params.Output.Count > 1:
    removeOutputs()
# ---------- end python_7 ----------

# ----
watchres = ShapeOpConstraintSolver(solution=solution.solution)  # -> readMe, residualValues; inputs quants: list
# ---------- watchres: Python ----------
import Rhino as rc
import Grasshopper as gh
from scriptcontext import sticky
import time
from datetime import datetime

def tail(filePath, lines=20):
    with open(filePath, 'rb') as f:
        total_lines_wanted = lines

        BLOCK_SIZE = 1024
        f.seek(0, 2)
        block_end_byte = f.tell()
        lines_to_go = total_lines_wanted
        block_number = -1
        blocks = [] # blocks of size BLOCK_SIZE, in reverse order starting
                    # from the end of the file
        while lines_to_go > 0 and block_end_byte > 0:
            if (block_end_byte - BLOCK_SIZE > 0):
                # read the last block we haven't yet read
                f.seek(block_number*BLOCK_SIZE, 2)
                blocks.append(f.read(BLOCK_SIZE))
            else:
                # file too small, start from begining
                f.seek(0,0)
                # only read what was not read
                blocks.append(f.read(block_end_byte))
            lines_found = blocks[-1].count('\n')
            lines_to_go -= lines_found
            block_end_byte -= BLOCK_SIZE
            block_number -= 1
        all_read_text = ''.join(reversed(blocks))

        return '\n'.join(all_read_text.splitlines()[-total_lines_wanted:])


filePath = r'C:\Users\Administrator\butterfly\outdoor_t_1\etc\simpleFoam.log'
filePath = r"C:\Users\Administrator\butterfly\outdoors_test_3\etc\simpleFoam.log"

if _solution:
    text = tail(_solution.logFile).split("\nTime =")[-1].split('\n')
    keys = ('Ux', 'Uy', 'Uz', 'epsilon', 'k')
    if 'res' not in sticky:
        sticky['res'] = dict.fromkeys(keys, 0)
    results = sticky['res']
    
    try:
        t = int(text[0])
    except:
        t = 'unknown'
    
    for line in text:
        try:
            p, ir, fr, ni = line.split('smoothSolver:  Solving for ')[1].split(',')
            results[p] = fr.split('= ')[-1]
            # print (p, ir.split('= ')[-1], fr.split('= ')[-1])
        except IndexError:
            pass
    print ">> {}".format(datetime.now())
    residualValues = (results[key] for key in keys)
    ghenv.Component.Message = "TimeStep = {}".format(t)
# ---------- end watchres ----------
panel_28 = Panel(solution.readMe)
graph = QuickGraph()
data_2 = Data()
panel_29 = Panel(watchres.residualValues)
loadprobesfromproject_3 = Butterfly_LoadProbesFromProject(field="U")  # -> values; plug-in component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
loadprobes = Butterfly_LoadProbes(case=data_2, field="U")  # -> skippedPoints, values; plug-in component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
loadprobesfromproject_4 = Butterfly_LoadProbesFromProject(solution=solution.solution, field="p")  # -> values; plug-in component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
loadprobesfromproject_5 = Butterfly_LoadProbesFromProject(solution=solution.solution, field="U")  # -> values; plug-in component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
loadprobes_2 = Butterfly_LoadProbes(field="p")  # -> skippedPoints, values; plug-in component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
tracker = ValueTracker(
    panel_29,
    TrackerAutoDomain=True,
    TrackerColour=RGB(255, 155, 0),
    TrackerPeriod=10,
    TrackerUpdate=25,
    TrackerDomain=[0, 1])

# ---- group: points
pt_5 = Point(flatten)

# ---- group: vectors
vec_3 = Vector(loadprobesfromproject_5)

# ----
# Results visualization
vlen = VectorLength(Vector=vec_3)
bnd = Bounds(Numbers=vlen)
scale = Slider(0.27, range=0..1)
remap = RemapNumbers(Value=vlen, Source=bnd, Target=Domain(1, 0))  # -> Mapped, Clipped
gradient = Gradient(
    LowerLimit=0,
    UpperLimit=1,
    Parameter=remap.Mapped,
    stops=[0: RGB(234, 38, 0), 0.25: RGB(234, 126, 0), 0.5: RGB(254, 244, 84), 0.75: RGB(173, 203, 249), 1: RGB(75, 107, 169)])
multiplication = Multiplication(A=vec_3, B=scale)
vdisex = VectorDisplayEx(Point=pt_5, Vector=multiplication, Colour=gradient, Width=Slider(2, range=0..5))

flatten_2 = FlattenTree(Tree=gentestpts.mesh, Path="{0}")
mjoin = MeshJoin(Meshes=flatten_2)
recolormesh = Ladybug_RecolorMesh(analysisResult=loadprobesfromproject_4, inputMesh=mjoin, analysisTitle="pressure", legendTitle="Pa")  # -> readMe, newMesh, newLegend, legendBasePt, meshColors, legendColors; plug-in component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
ladybug = Ladybug_Ladybug()  # -> Vviiiiiiiiiizzz; plug-in component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
