# Grasshopper definition createSimpleBoxCase.gh (Grasshopper 0.9.76)
# plug-ins: Python Interpreter

number_slider = Slider(4, range=0..10)
python = PythonScript(frontX=Slider(2, range=0..10), topX=4, sidesX=Slider(1, range=0..1), backX=5)  # -> out, tunnelPar
# ---------- python: Python ----------
class TunnelParameters(object):
    """Wind tunnel parameters."""
    def __init__(self, front=2, top=4, side=2, back=5):
        """Init wind tunnel parameters."""
        self.front = front
        self.top = top
        self.side = side
        self.back = back

    def _checkInput(self, input):
        """Check input values."""
        try:
            _inp = float(input)
        except:
            raise ValueError("Failed to convert %s to a number." % input)
        else:
            assert _inp > 0, "Value (%.2f) should be larger than 0." % _inp

    def ToString(self):
        return self.__repr__()
        
    def __repr__(self):
        return 'F: %.1fX; T: %.1fX; S: %.1fX; B: %.1fX;' % (
                self.front, self.top, self.side, self.back)


tunnelPar = TunnelParameters(_frontX_, _topX_, _sidesX_, _backX_)
# ---------- end python ----------

# ---- group: I don't know what to call these
python_2 = PythonScript()  # -> epsilonWallFunction
# ---------- python_2: Python ----------
import sys
sys.path.append("C:/Users/Administrator/Dropbox/ladybug/Butterfly")
from butterfly.fields import EpsilonWallFunction

epsilonWallFunction = EpsilonWallFunction(value, Cmu, kappa, E)
# ---------- end python_2 ----------
python_3 = PythonScript()  # -> nutkWallFunction
# ---------- python_3: Python ----------
import sys
sys.path.append("C:/Users/Administrator/Dropbox/ladybug/Butterfly")
from butterfly.fields import NutkWallFunction

nutkWallFunction = NutkWallFunction(value, Cmu, kappa, E)
# ---------- end python_3 ----------
python_4 = PythonScript(value="0.01")  # -> kqRWallFunction
# ---------- python_4: Python ----------
import sys
sys.path.append("C:/Users/Administrator/Dropbox/ladybug/Butterfly")
from butterfly.fields import KqRWallFunction

if value:
    kqRWallFunction = KqRWallFunction(value)
# ---------- end python_4 ----------
python_5 = PythonScript(value="(0 0 0)")  # -> fixedValue
# ---------- python_5: Python ----------
import sys
sys.path.append("C:/Users/Administrator/Dropbox/ladybug/Butterfly")
from butterfly.fields import FixedValue

if value:
    fixedValue = FixedValue(value)
# ---------- end python_5 ----------
python_6 = PythonScript()  # -> zeroGradient
# ---------- python_6: Python ----------
import sys
sys.path.append("C:/Users/Administrator/Dropbox/ladybug/Butterfly")
from butterfly.fields import ZeroGradient

zeroGradient = ZeroGradient()
# ---------- end python_6 ----------
python_7 = PythonScript()  # -> calculated
# ---------- python_7: Python ----------
import sys
sys.path.append("C:/Users/Administrator/Dropbox/ladybug/Butterfly")
from butterfly.fields import Calculated

calculated = Calculated()
# ---------- end python_7 ----------

# ----
python_8 = PythonScript(butterflyFolder="C:/Users/Administrator/Dropbox/ladybug/Butterfly")  # -> out
# ---------- python_8: Python ----------
import sys
sys.path.append(butterflyFolder)

try:
    import butterfly
    print "imported buttefly! swoosh swoosh..."
except ImportError:
    raise "Incorrect butterfly folder. Failed to import butterfly!"
# ---------- end python_8 ----------
vec = Vector(Vector(240.4114765, -4.937511204, 0))
brep = Brep(<brep referenced from the Rhino model>)
pt = ConstructPoint(XCoordinate=0, YCoordinate=0, ZCoordinate=0)
panel = Panel(python_8)
python_9 = PythonScript(geo=brep, windSpeed="2", windDir=vec, tunnelPar=python.tunnelPar)  # -> out, tunnel; inputs geo: GeometryBase, windDir: Vector3d, plane2D: Plane
# ---------- python_9: Python ----------
import Rhino as rc
from math import pi as PI


class WindTunnel(object):
    
    def __init__(self, geo, windSpeed, windDirection, tunnelParameters):
        """Init wind tunnel."""
        self.geo = geo
        self.windSpeed = windSpeed
        self.windDirection = windDirection
        self.tunnelParameters = tunnelParameters
    
        self.plane = self.calculatePlane()
    
        # find boundingbox
        self.dimensions, self.boundingbox = self.getBoundingBox()
        
        # scale boundingbox from the projected center based on parameters
        self.tunnelGeometry = self.scaleBoundingBox()

    def calculatePlane(self):
        """calculate base plane for wind tunnel."""
        # create plane based on winDir
        xAxis = rc.Geometry.Vector3d(self.windDirection.X,
                                     self.windDirection.Y,
                                     self.windDirection.Z)
        yAxis = rc.Geometry.Vector3d(xAxis)
        yAxis.Rotate(PI/2, rc.Geometry.Vector3d.ZAxis)
        return rc.Geometry.Plane(rc.Geometry.Point3d.Origin, xAxis, yAxis)
        
    def __getDimension(self, min, max, plane, axis):
        
        perpPlane = rc.Geometry.Plane(plane)
        perpPlane.Rotate(PI/2, axis)
        
        maxN = perpPlane.ClosestPoint(max)
        maxN.Z = 0
        minN = perpPlane.ClosestPoint(min)
        minN.Z = 0
        
        return minN.DistanceTo(maxN)
     
    
    def getBoundingBox(self):
        """Get bounding box for a geometry in a plane."""
        
        world = rc.Geometry.Plane.WorldXY
        
        bbox = self.geo.GetBoundingBox(self.plane)
        plane_to_world = rc.Geometry.Transform.ChangeBasis(self.plane, world)
            
        box = bbox.ToBrep()
        box.Transform(plane_to_world)
        
        min = bbox.Min
        min.Transform(plane_to_world)
        
        max = bbox.Max
        max.Transform(plane_to_world)
        
        xDimension = getDimension(min, max, self.plane, self.plane.XAxis)
        yDimension = getDimension(min, max, self.plane, self.plane.YAxis)
        zDimension = max.Z - min.Z
        
        return (xDimension, yDimension, zDimension), box


    def scaleBoundingBox(self):
        """Scale original bounding box to create wind tunnel."""
        
        vp = rc.Geometry.VolumeMassProperties.Compute(self.boundingbox)
        
        cenPt = (vp.Centroid.X, vp.Centroid.Y, 0)
        vp.Dispose()
        
        self.plane.Origin = rc.Geometry.Point3d(*cenPt)
        
        xScale = (self.tunnelParameters.front + self.tunnelParameters.back) \
                 * (self.dimensions[2] / self.dimensions[0]) + 1
        
        yScale = (2 * self.tunnelParameters.side
                  * (self.dimensions[2] / self.dimensions[1])) + 1
        
        zScale = self.tunnelParameters.top + 1
        
        _scale = rc.Geometry.Transform.Scale(self.plane, xScale, yScale, zScale)
        
        self.boundingbox.Transform(_scale)
        
        moveVector = ((self.tunnelParameters.back + self.tunnelParameters.front) 
                      / 2 - self.tunnelParameters.front) \
                      * self.plane.XAxis \
                      * self.dimensions[2]
        
        self.boundingbox.Transform(rc.Geometry.Transform.Translation(moveVector.X, moveVector.Y, moveVector.Z))
       
        return self.boundingbox


wt = WindTunnel(_geo, _windSpeed, _windDir_, _tunnelPar_)
tunnel = wt.tunnelGeometry
# ---------- end python_9 ----------
vdis = VectorDisplay(Anchor=pt, Vector=vec)

# ---- group: create your own
python_10 = PythonScript(bcType="patch", U=python_6, p=python_6, k=python_6, epsilon=python_7, nut=python_7)  # -> out, boundaryFields
# ---------- python_10: Python ----------
import sys
sys.path.append("C:/Users/Administrator/Dropbox/ladybug/Butterfly")

import butterfly
from butterfly import boundarycondition
reload(butterfly)
reload(butterfly.boundarycondition)

if not bcType:
    bcType = 'patch'

boundaryFields = boundarycondition.BoundaryCondition(
    bcType, refLevels=None, u=U, p=p, k=k, epsilon=epsilon, nut=nut
)

boundaryFields = boundaryFields.duplicate()
# ---------- end python_10 ----------

# ----
vec_2 = VectorXYZ(XComponent="2", YComponent=0, ZComponent=0)  # -> Vector, Length
panel_2 = Panel(python_10.boundaryFields)
wall = PythonScript(boundaryFields=python_10.boundaryFields)  # -> BC
# ---------- wall: Python ----------
import sys
sys.path.append("C:/Users/Administrator/Dropbox/ladybug/Butterfly")

import butterfly
from butterfly import boundarycondition as bc

if not refLevels:
    refLevels = (0, 0)

if not boundaryFields:
    BC = bc.BoundaryCondition('patch', refLevels=refLevels)
else:
    boundaryFields.refLevels = refLevels
    BC = boundaryFields.duplicate()
# ---------- end wall ----------
wall_2 = PythonScript(velocityVec=vec_2.Vector, refLevels="(5, 5)")  # -> inletBC; inputs velocityVec: Vector3d
# ---------- wall_2: Python ----------
import sys
sys.path.append("C:/Users/Administrator/Dropbox/ladybug/Butterfly")

import butterfly
from butterfly import boundarycondition as bc
from butterfly.fields import FixedValue
reload(butterfly)
reload(butterfly.boundarycondition)
#reload(butterfly.fields)

velocityVec = FixedValue(str(tuple(velocityVec)).replace(',', '')) \
              if velocityVec \
              else None

inletBC = bc.InletBoundaryCondition(refLevels=refLevels, u=velocityVec)
# ---------- end wall_2 ----------
wall_3 = PythonScript(refLevels="(10, 10)")  # -> wallBC
# ---------- wall_3: Python ----------
import sys
sys.path.append("C:/Users/Administrator/Dropbox/ladybug/Butterfly")

import butterfly
from butterfly import boundarycondition as bc

reload(butterfly)
reload(butterfly.boundarycondition)

wallBC = bc.WallBoundaryCondition(refLevels=refLevels)
# ---------- end wall_3 ----------
wall_4 = PythonScript(refLevels="(5, 5)")  # -> outletBC
# ---------- wall_4: Python ----------
import sys
sys.path.append("C:/Users/Administrator/Dropbox/ladybug/Butterfly")

import butterfly
from butterfly import boundarycondition as bc
from butterfly.fields import FixedValue

reload(butterfly)
reload(butterfly.boundarycondition)
pressure = FixedValue(pressure) if pressure else None
outletBC = bc.OutletBoundaryCondition(refLevels=refLevels, p=pressure)
# ---------- end wall_4 ----------
# How to add meshingPar
# to wind tunnel?
python_11 = PythonScript()  # -> Out, Case
jagged = SettingsSpeed()

# ---- group: inlet!
srf = Surface(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)

# ----
srf_2 = Surface(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)
brep_2 = Brep(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)
area = Area(Geometry=srf)  # -> Area, Centroid
preview = CustomPreview(Geometry=[srf_2, srf], Shader=ColourSwatch(SwatchColor=RGBA(136, 191, 255, 77)))
wires = BrepWireframe(Brep=brep_2, Density=-1)
vdis_2 = VectorDisplay(Anchor=area.Centroid, Vector=vec_2.Vector)

# ---- group: butterfly face
python_12 = PythonScript(geo=srf, name="west_window", BC=wall_2, meshSet=jagged)  # -> out, BFSrf; inputs geo: list of GeometryBase
# ---------- python_12: Python ----------
import sys
sys.path.append("C:/Users/Administrator/Dropbox/ladybug/Butterfly")

import butterfly
from butterfly.gh import BFSurface

reload(butterfly)
reload(butterfly.gh)

BFSrf = BFSurface(name, geo, BC, meshSet)
# ---------- end python_12 ----------

# ----
python_13 = PythonScript(geo=brep_2, name="room", BC=wall_3, meshSet=jagged)  # -> out, BFSrf; inputs geo: list of GeometryBase; same code as python_12
python_14 = PythonScript(geo=srf_2, name="east_window", BC=wall_4, meshSet=jagged)  # -> out, BFSrf; inputs geo: list of GeometryBase; same code as python_12
number_slider_2 = Slider(10, range=0..10)
box = DomainBox(Base=PlaneXY(0, 0, 0), X=number_slider_2, Y=number_slider_2, Z=number_slider_2)
python_15 = PythonScript(bbox=box, nDivXYZ="{2,2,2}", gradXYZ="{1,1,1}")  # -> blockMeshDict; inputs bbox: GeometryBase, nDivXYZ: Point3d, gradXYZ: Point3d
# ---------- python_15: Python ----------
# import butterfly
from butterfly.gh import BFSurface, Block
from butterfly.blockMeshDict import BlockMeshDict
#import butterfly
from butterfly.boundarycondition import BoundingBoxBoundaryCondition
#reload(butterfly.blockMeshDict)
#reload(butterfly.boundarycondition)

# create blockMeshDict based on BBox
block = Block(bbox, nDivXYZ, gradXYZ)
bc = BoundingBoxBoundaryCondition()
BBBFSurface = BFSurface('boundingbox', [bbox], bc)
blockMeshDict = BlockMeshDict(1, [BBBFSurface], [block])
# ---------- end python_15 ----------

# ---- group: what are the parameters that are the most important to be added here?
python_16 = PythonScript()

# ----
dom = ConstructDomain(DomainStart="1", DomainEnd="2")

# ---- group: Create and write the case!
python_17 = PythonScript(
    name="indoor_airflow",
    BFSrfs=flatten([python_13.BFSrf, python_12.BFSrf, python_14.BFSrf]),
    blockMeshDict=python_15,
    globalRefLevel=dom)  # -> out, case; inputs BFSrfs: list
# ---------- python_17: Python ----------
import butterfly
from butterfly.core import Case
reload(butterfly)
reload(butterfly.gh)
reload(butterfly.foamfile)
reload(butterfly.helper)
reload(butterfly.core)
reload(butterfly.runmanager)
#reload(butterfly.snappyHexMeshDict)
#reload(butterfly.fvSchemes)

# create OpenFoam Case
case = Case(name, BFSrfs, blockMeshDict, globalRefLevel, blockMeshDict.center,
            isSnappyHexMesh=True)

case.createCaseFolders()
case.populateContents()

# run blockMesh
case.blockMesh()
# ---------- end python_17 ----------

# ----
panel_3 = Panel(python_17.out)

# ---- group: snappyHexMesh
meshguidepoint = PythonScript(case=python_17.case, snappyHexMeshDict=python_16, run=Toggle(False))  # -> out, case; inputs meshGuidePoint: Point3d
# ---------- meshguidepoint: Python ----------
if case:
    if not _meshGuidePoint_:
        _meshGuidePoint_ = case.blockMeshDict.center
    else:
        _meshGuidePoint_ = tuple(_meshGuidePoint_)

    if _snappyHexMeshDict_ and hasattr(_snappyHexMeshDict_, 'locationInMesh'):
        case.snappyHexMeshDict = _snappyHexMeshDict_
        
    case.snappyHexMeshDict.locationInMesh = _meshGuidePoint_
    
    
    if _run:
        case.snappyHexMesh()
# ---------- end meshguidepoint ----------

# ----
brep_3 = Brep([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])
python_18 = PythonScript(geo=brep_3, nDivXYZ="{1,1,1}", gradXYZ="{1,1,1}")  # -> out, block; inputs geo: Brep, nDivXYZ: Point3d, gradXYZ: Point3d; disabled
# ---------- python_18: Python ----------
import sys
sys.path.append("C:/Users/Administrator/Dropbox/ladybug/Butterfly")

import butterfly
from butterfly.gh import Block

reload(butterfly)
reload(butterfly.gh)

block = Block(geo, nDivXYZ, gradXYZ)
# ---------- end python_18 ----------
wires_2 = BrepWireframe(Brep=brep_3, Density=-1)
python_19 = PythonScript(name="innerflow_2", blocks=python_18.block)  # -> out, c; inputs BFSrfs: list, blocks: list; disabled
# ---------- python_19: Python ----------
import sys
sys.path.append("C:/Users/Administrator/Dropbox/ladybug/Butterfly")

import butterfly
from butterfly.foamfile import FoamFile
from butterfly.core import Case

reload(butterfly)
reload(butterfly.blockMeshDict)
reload(butterfly.foamfile)
reload(butterfly.core)

c = Case.fromBlocks(BFSrfs, blocks, 1)
c.write(name)
# ---------- end python_19 ----------
panel_4 = Panel(python_19.out)

simplefoam = PythonScript(case=meshguidepoint.case, run=Toggle(False))  # -> out, case
# ---------- simplefoam: Python ----------
if run:
    case.copySnappyHexMesh()
    case.renameSnappyHexMeshFolders()
    case.simpleFoam()
    # rename the folders back
    case = case.renameSnappyHexMeshFolders()
# ---------- end simplefoam ----------
data = Data(python_17.case)
python_20 = PythonScript(case=data, load=Toggle(False))  # -> mesh; inputs load: Boolean
# ---------- python_20: Python ----------
if case and load:
    case.copySnappyHexMesh()
    mesh = case.loadMesh()
# ---------- end python_20 ----------
python_21 = PythonScript(case=meshguidepoint.case, load=Toggle(False))  # -> velocityVectors; inputs load: Boolean
# ---------- python_21: Python ----------
if case and load:
    velocityVectors = case.loadVelocity()
# ---------- end python_21 ----------
python_22 = PythonScript(case=meshguidepoint.case, load=Toggle(False))  # -> pts; inputs load: Boolean
# ---------- python_22: Python ----------
if case and load:
    case.copySnappyHexMesh()
    pts = case.loadPoints()
# ---------- end python_22 ----------
panel_5 = Panel("C:\Users\Administrator\butterfly\study_room\constant\polyMesh")

pt_2 = Point(Point(5.246792205, 3.706414975, 3.184472171))
xz = XZPlane(Origin=pt_2)
xy = XYPlane(Origin=pt_2)
vec_3 = Vector(python_21)
pt_3 = Point(python_22)
project = Project(Geometry=pt_3, Plane=xz)  # -> Geometry, Transform
dist = Distance(PointA=project.Geometry, PointB=pt_3)
num = Number("0.2")
smaller = SmallerThan(FirstNumber=dist, SecondNumber=num)  # -> SmallerThan, OrEqualTo
cull = CullPattern(List=vec_3, CullPattern=smaller.OrEqualTo)
vlen = VectorLength(Vector=cull)
bnd = Bounds(Numbers=vlen)
remap = RemapNumbers(Value=cull, Source=bnd, Target=Domain(1, 0))  # -> Mapped, Clipped
gradient = Gradient(
    LowerLimit=0,
    UpperLimit=1,
    Parameter=remap.Mapped,
    stops=[0: RGB(234, 38, 0), 0.25: RGB(234, 126, 0), 0.5: RGB(254, 244, 84), 0.75: RGB(173, 203, 249), 1: RGB(75, 107, 169)])
cull_2 = CullPattern(List=pt_3, CullPattern=smaller.OrEqualTo)
cull_3 = CullPattern(List=vec_3, CullPattern=smaller.OrEqualTo)
vdisex = VectorDisplayEx(Point=cull_2, Vector=cull_3, Colour=gradient, Width=Slider(1, range=0..1))

python_23 = PythonScript(studyFolder="C:\Users\Administrator\butterfly\study_room\500")  # -> vectors
# ---------- python_23: Python ----------
import Rhino as rc
import os

def splitLine(l, t=float):
    return tuple(t(s) for s in l.split('(')[-1].replace(')', '').split())


def loadVectors(studyFolder):
    pf = os.path.join(studyFolder, 'U')
    
    if not os.path.isfile(pf):
        print "Can't find vector file."
        return
        
    # read vectors
    with open(pf, 'rb') as ptFile:
        for l in xrange(21):
            line = ptFile.readline()       
        nVectors = int(line)
        ptFile.readline()
        vectors = tuple(
                   rc.Geometry.Vector3d(*splitLine(ptFile.readline()))
                   for pt in xrange(nVectors)
            )
    return vectors

vectors = loadVectors(studyFolder)
# ---------- end python_23 ----------
python_24 = PythonScript(studyFolder=panel_5)  # -> pts
# ---------- python_24: Python ----------
import Rhino as rc
import os

def splitLine(l, t=float):
    return tuple(t(s) for s in l.split('(')[-1].replace(')', '').split())


def loadPoints(studyFolder):
    pf = os.path.join(studyFolder, 'points')
    
    if not os.path.isfile(pf):
        print "Can't find point and faces file."
        return
        
    # read points
    with open(pf, 'rb') as ptFile:
        for l in xrange(17):
            ptFile.readline()
        
        try:
            # blockMesh
            line = ptFile.readline()
            nPoints = int(line[0])
            pts = tuple(
                       rc.Geometry.Point3d(*pt)
                       for pt in eval(line[1:].replace(" ", ", "))
                       )
        except:
            #snappyHexMesh
            line = ptFile.readline()
            nPoints = int(line)
            ptFile.readline()
            pts = tuple(
                       rc.Geometry.Point3d(*splitLine(ptFile.readline()))
                       for pt in xrange(nPoints)
                )

    return pts

pts = loadPoints(studyFolder)
# ---------- end python_24 ----------

panel_6 = Panel("C:\Users\Administrator\Dropbox\ladybug\Butterfly\other_files\OpenFOAM_Sample_Files\innerflow\constant\polyMesh")
python_25 = PythonScript(studyFolder="C:\Users\Administrator\butterfly\atrium2d\3\polyMesh")  # -> out, mesh
# ---------- python_25: Python ----------
import Rhino as rc
import os

def splitLine(l, t=float):
    return tuple(t(s) for s in l.split('(')[-1].replace(')', '').split())

def OFMeshToRhino(studyFolder):
    if not studyFolder:
        return

    pf = os.path.join(studyFolder, 'points')
    ff = os.path.join(studyFolder, 'faces')
    
    if not os.path.isfile(pf) or not os.path.isfile(ff):
        print "Can't find point and faces file."
        return
        
    # read points
    with open(pf, 'rb') as ptFile:
        for l in xrange(17):
            ptFile.readline()
        
        try:
            # blockMesh
            line = ptFile.readline()
            nPoints = int(line[0])
            pts = tuple(
                       rc.Geometry.Point3d(*pt)
                       for pt in eval(line[1:].replace(" ", ", "))
                       )
        except:
            #snappyHexMesh
            line = ptFile.readline()
            nPoints = int(line)
            ptFile.readline()
            pts = tuple(
                       rc.Geometry.Point3d(*splitLine(ptFile.readline()))
                       for pt in xrange(nPoints)
                )

            
    # read faces
    with open(ff, 'rb') as faceFile:
       for l in xrange(18):
           faceFile.readline()
       
       nFaces = int(faceFile.readline())
       faceFile.readline()
       faces = tuple((splitLine(faceFile.readline(), t=int))
                   for pt in xrange(nFaces)
            )
    
    # create the mesh
    mesh = rc.Geometry.Mesh()

    for p in pts:
        mesh.Vertices.Add(p)

    for face in faces:
        if len(face) < 5:
            mesh.Faces.AddFace(*face)
        elif len(face) == 5:
            mesh.Faces.AddFace(*face[:3])
            mesh.Faces.AddFace(*face[:1] + (face[3:]))
        elif len(face) == 8:
            mesh.Faces.AddFace(*face[:4])
            mesh.Faces.AddFace(*(face[0], face[3], face[4], face[7]))
            mesh.Faces.AddFace(*(face[7], face[4], face[5], face[6]))
        else:
            try:
                mesh.Faces.AddFace(*face[:4])
                mesh.Faces.AddFace(*face[:1] + (face[4:]))
            except:
                msg = "One of the faces has %d vertices." % len(face)
                print msg

    return mesh

mesh = OFMeshToRhino(studyFolder)
# ---------- end python_25 ----------
pt_4 = Point(Point(5.246792205, 3.706414975, 3.184472171))
xz_2 = XZPlane(Origin=pt_4)
xy_2 = XYPlane(Origin=pt_4)
yz = YZPlane(Origin=pt_4)
mesh = Mesh(python_25.mesh)
sec = MeshPlane(Mesh=mesh, Plane=xy_2)

panel_7 = Panel("C:\Users\Administrator\butterfly\innerflow_3\constant\polyMesh")
panel_8 = Panel("result visualization")
panel_9 = Panel(python_25.out)
