# Dynamo graph outdoor_study.dyn (Dynamo 1.2.1.3083)

code_block = CodeBlock { x = 10; y = 20; z = 20; z / 2; }
byCoordinates = Point.ByCoordinates(z=code_block.out3)
XAxis = Vector.XAxis()
code_block_2 = CodeBlock { 1; }
make2d_parameters = Custom[Make2d Parameters](origin=byCoordinates, normal=XAxis, width=code_block_2)  # Make a case 2d.
code_block_3 = CodeBlock { "outdoor_study"; }
code_block_4 = CodeBlock { "building"; }
byLengths = Cuboid.ByLengths(origin=byCoordinates, width=code_block.x, length=code_block.x, height=code_block.z)
create_butterfly_geometry = Custom[Create Butterfly Geometry](name=code_block_4, geo=byLengths)  # Create Butterfly surface. -
code_block_5 = CodeBlock { 5; }
wind_vector = Custom[Wind Vector](windSpeed=code_block_5)  # Wind vector. -
wind_tunnel_parameters = Custom[Wind Tunnel Parameters]()  # Wind tunnel parameters. -
boolean = BoolSelector(true)
create_case_from_tunnel = Custom[Create Case from Tunnel](name=code_block_3, BFGeometries=create_butterfly_geometry.BFGeometries, windVector=wind_vector.windVector, tunnelParams=wind_tunnel_parameters.tunnelParams, run=boolean)  # Create Case from wind tunnel. -
boolean_2 = BoolSelector(true)
blockMesh = Custom[blockMesh](case=create_case_from_tunnel.case, run=boolean_2)  # blockMesh -
boolean_3 = BoolSelector(false)
code_block_6 = CodeBlock { "castellatedMeshControls  {resolveFeatureAngle 95; }"; }
snappyHexMeshDict = Custom[snappyHexMeshDict](snap=boolean_3, additionalParameters=code_block_6)  # Set parameters for snappyHexMeshDict. Read more about snappyHexMeshDict here: https://openfoamwiki.net/images/f/f0/Final-AndrewJacksonSlidesOFW7.pdf
boolean_4 = BoolSelector(true)
snappyHexMesh = Custom[snappyHexMesh](case=blockMesh.case, snappyHexMeshDict=snappyHexMeshDict.snappyHexMeshDict, run=boolean_4)  # snappyHexMesh -
boolean_5 = BoolSelector(true)
load_mesh = Custom[Load Mesh](case=snappyHexMesh.case, load=boolean_5)  # Load mesh from the case for preview. -
watch = Watch(load_mesh.ERRReport)
watch_2 = Watch(create_case_from_tunnel.pts)
