# Grasshopper definition indoor_airflow.gh (Grasshopper 0.9.76)
# plug-ins: Python Interpreter

epsilonwallfunction = Butterfly_epsilonWallFunction(Cmu=0.09, kappa=0.4, E=9.8)  # -> epsilonWallFunction; plug-in component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
nutkwallfunction = Butterfly_nutkWallFunction()  # -> nutkWallFunction; plug-in component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
kqrwallfunction = Butterfly_kqRWallFunction(value="0.01")  # -> kqRWallFunction; plug-in component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
fixedvalue = Butterfly_fixedValue(value="(0 0 0)")  # -> fixedValue; plug-in component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
zerogradient = Butterfly_zeroGradient()  # -> zeroGradient; plug-in component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
calculated = Butterfly_calculated()  # -> calculated; plug-in component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

# ----
# Create your own boundary
# from boundary conditions
panel = Panel("patch")
panel_2 = Panel(nutkwallfunction)

# ---- group: create your own
boundary = Butterfly_Boundary(bType=panel, U=zerogradient, p=zerogradient, k=zerogradient, epsilon=calculated, nut=calculated)  # -> readMe, boundary; plug-in component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

# ---- group: Alternate inlet boundary based on volumetric flow rate
inlet = Butterfly_InletFlowRateBoundary(volFlowRate="28")  # -> inletBoundary; plug-in component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

# ----
vec = VectorXYZ(XComponent="2", YComponent=0, ZComponent=0)  # -> Vector, Length
wall = Butterfly_WallBoundary()  # -> wallBoundary; plug-in component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
outlet = Butterfly_OutletBoundary()  # -> outletBoundary; plug-in component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
inlet_2 = Butterfly_InletBoundary(velocityVec=vec.Vector)  # -> inletBoundary; plug-in component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

# ---- group: inlet!
# 0. CREATE BUTTERFLY SURFACES
srf = Surface(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)

# ---- group: outlet
srf_2 = Surface([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])

# ---- group: walls
brep = Brep(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)

# ----
area = Area(Geometry=srf)  # -> Area, Centroid
wires = BrepWireframe(Brep=brep, Density=-1)
vdis = VectorDisplay(Anchor=area.Centroid, Vector=vec.Vector)
preview = CustomPreview(Geometry=[srf_2, srf], Shader=ColourSwatch(SwatchColor=RGBA(136, 191, 255, 77)))
jagged = SettingsSpeed()
larger_than_90_to_get_the_hard_edges = Panel("castellatedMeshControls  {resolveFeatureAngle 95;}")
meshparams = Butterfly_MeshingParameters(cellSizeXYZ="{0.5, 0.5, 0.5}")  # -> readMe, meshParams; plug-in component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
createbfgeometry = Butterfly_CreateButterflyGeometry(name="west_window", geo=flatten(srf), boundary=inlet_2, refineLevels="(2, 2)", meshSet=jagged)  # -> readMe, BFGeometries; plug-in component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
createbfgeometry_2 = Butterfly_CreateButterflyGeometry(name="room", geo=flatten(brep), boundary=wall, meshSet=jagged)  # -> readMe, BFGeometries; plug-in component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
createbfgeometry_3 = Butterfly_CreateButterflyGeometry(name="east_window", geo=flatten(srf_2), boundary=outlet, refineLevels="(2, 2)", meshSet=jagged)  # -> readMe, BFGeometries; plug-in component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

# ---- group: turn off the sanp to get the hard edges correctly
toggle = BooleanToggle(False)

# ----
# 1. CREATE OPENFOAM CASE
panel_3 = Panel("indoor_airflow")

# ---- group: update inlet wind velocity
panel_4 = Panel("""boundaryField
{

west_window
    {

  
value		uniform (3.5 0.0 0.0);

}
}""")
panel_5 = Panel("U")

# ----
snappyhexmeshdict = Butterfly_snappyHexMeshDict(
    castellatedMesh=True,
    snap=toggle,
    addLayers=False,
    nCellsBetweenLevels=3,
    maxGlobalCells=2000000,
    additionalParameters=larger_than_90_to_get_the_hard_edges)  # -> snappyHexMeshDict; plug-in component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

# ---- group: Create and write the case!
casefromgeos = Butterfly_CreateCaseFromGeometries(
    name=panel_3,
    BFGeometries=flatten([createbfgeometry_2.BFGeometries, createbfgeometry_3.BFGeometries, createbfgeometry.BFGeometries]),
    meshParams=meshparams.meshParams,
    expandBlockMesh=True,
    run=Toggle(False))  # -> readMe, blockPts, case; plug-in component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

# ----
number_slider = Slider(0.5, range=0..1)
toggle_2 = BooleanToggle(False)
panel_6 = Panel(casefromgeos.readMe)
brep_2 = Brep([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])
# PURGE CASE
purgecase = Butterfly_purgeCase(case=casefromgeos.case, blockMesh=False, snappyHexMesh=False, results=toggle_2, postProcessing=toggle_2)  # -> readMe; plug-in component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
panel_7 = Panel(casefromgeos.blockPts)
gentestpts = Honeybee_GenerateTestPoints(testGeometry=brep_2, gridSize="0.3", distBaseSrf="0.05", moveTestMesh=Toggle(False))  # -> readMe, simplify(testPoints), simplify(ptsVectors), simplify(facesArea), simplify(mesh); plug-in component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

# ---- group: sample the box in 3D
bbox = BoundingBox(Content=brep, Plane=PlaneXY(0, 0, 0), UnionBox=True)  # -> Box, Box_2
range = Range(Domain=Domain(0.05, 0.95), Steps=10)
crossref = CrossReference(ListA=range, ListB=range, ListC=range, CrossMode=1)  # -> ListA, ListB, ListC
box = EvaluateBox(Box=bbox.Box, UParameter=crossref.ListA, VParameter=crossref.ListB, WParameter=crossref.ListC)  # -> Plane, Point, Include

# ----
# 2.1. BLOCKMESH
blockmesh = Butterfly_blockMesh(case=casefromgeos.case, overwrite=True, run=Toggle(False))  # -> readMe, case; plug-in component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
panel_8 = Panel("""p
U""")
flatten = FlattenTree(Tree=gentestpts.mesh, Path="{0}")
flatten_2 = FlattenTree(Tree=gentestpts.testPoints, Path="{0}")
controldict = Butterfly_controlDict(startTime=0, endTime=Slider(5000, range=0..10000), writeInterval=100, writeCompression=False)  # -> controlDict; plug-in component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

# ---- group: Once you make a change using a solution parameter disconnecting the component won't undo the changes
solutionparam = Butterfly_SolutionParameter(filename=panel_5, values=panel_4, replace=False)  # -> solutionParam; plug-in component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

# ----
probes = Butterfly_probes(pts=flatten_2, fields=panel_8)  # -> probes; plug-in component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
decomposepardict = Butterfly_decomposeParDict(mode=0, numOfCpus="2")  # -> decomposeParDict; plug-in component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
# 2. MESHING
# 2.2. SNAPPYHEXMESH
snappyhexmesh = Butterfly_snappyHexMesh(case=blockmesh.case, snappyHexMeshDict=snappyhexmeshdict, run=Toggle(False))  # -> readMe, case; plug-in component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
steadyincomp = Butterfly_SteadyIncompressibleRecipe()  # -> readMe, recipe; plug-in component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
solutionparams = Butterfly_SolutionParameters(controlDict=controldict, probes=probes)  # -> solutionParams; plug-in component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
# VISUALIZE MESH
loadmesh = Butterfly_LoadMesh(case=snappyhexmesh.case, innerMesh=False, load=Toggle(True))  # -> mesh; plug-in component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
# Solution should be converged in 586 iterations with default settings.
toggle_3 = BooleanToggle(False)
faceb = FaceBoundaries(Mesh=loadmesh)
# 3. SOLUTION
solution = Butterfly_Solution(
    case=snappyhexmesh.case,
    recipe=steadyincomp.recipe,
    solutionParams=solutionparams,
    interval=2,
    write=toggle_3,
    run=Toggle(False))  # -> readMe, solution, isRunning, timestep, residualFields, residualValues, logFiles; plug-in component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
panel_9 = Panel(solution.residualFields)
loadprobesvalue = Butterfly_LoadProbesValue(solution=solution.solution, field="p")  # -> values; plug-in component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
loadprobesvalue_2 = Butterfly_LoadProbesValue(solution=solution.solution, field="U")  # -> values; plug-in component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
panel_10 = Panel(solution.residualValues)

# ---- group: points
pt = Point(flatten_2)

# ---- group: vectors
vec_2 = Vector(loadprobesvalue_2)

# ----
rec = Rectangle({Plane=PlaneXY(1, -6, 0), Size=Domain2(u=0..15, v=0..5)})
mjoin = MeshJoin(Meshes=flatten)
vlen = VectorLength(Vector=vec_2)
# PLOT RESIDUALS
plotresiduals = Butterfly_PlotResiduals(solution=solution.solution, rect=rec, targetRes=0.0001, port=0.1, method=0, load=Toggle(False))  # -> readMe, timeRange, curves, port, residualLine, colors; plug-in component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
bnd = Bounds(Numbers=vlen)
panel_11 = Panel(bnd)
gradientlibrary = Ladybug_GradientLibrary(gradIndex="7")  # -> customColors; plug-in component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
dedomain = DeconstructDomain(Domain=bnd)  # -> Start, End
gradient = Gradient(
    LowerLimit=dedomain.End,
    UpperLimit=dedomain.Start,
    Parameter=vlen,
    stops=[0: RGB(234, 38, 0), 0.25: RGB(234, 126, 0), 0.5: RGB(254, 244, 84), 0.75: RGB(173, 203, 249), 1: RGB(75, 107, 169)])
preview_2 = CustomPreview(Geometry=plotresiduals.curves, Shader=plotresiduals.colors)
# 4. RESULT VISUALIZATION
legendpar = Ladybug_LegendParameters(customColors=flatten(gradientlibrary))  # -> legendPar; plug-in component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
panel_12 = Panel(plotresiduals.readMe)
ladybug = Ladybug_Ladybug()  # -> Vviiiiiiiiiizzz; plug-in component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
recolormesh = Ladybug_RecolorMesh(analysisResult=loadprobesvalue, inputMesh=mjoin, legendPar=legendpar, analysisTitle="Pressure.", legendTitle="Pa.")  # -> readMe, newMesh, newLegend, legendBasePt, meshColors, legendColors; plug-in component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
scale = Slider(0.18, range=0..1)
faceb_2 = FaceBoundaries(Mesh=recolormesh.newMesh)
multiplication = Multiplication(A=vec_2, B=scale)
mesh = Mesh(recolormesh.newLegend)
preview_3 = CustomPreview(Geometry=faceb_2, Shader=recolormesh.meshColors)
vdisex = VectorDisplayEx(Point=pt, Vector=multiplication, Colour=gradient, Width=Slider(2, range=0..5))
