# Grasshopper definition outdoor_airflow.gh (Grasshopper 0.9.76)
# plug-ins: Python Interpreter

brep = Brep([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])
panel = Panel("""20
60
20""")
panel_2 = Panel("""0.1
0.3
0.6""")

# ---- group: create refinement region
number_slider = Slider(1.5, range=0..10)
bbox = BoundingBox(Content=brep, Plane=PlaneXY(0, 0, 0), UnionBox=True)  # -> Box, Box_2
area = Area(Geometry=bbox.Box)  # -> Area, Centroid
project = Project(Geometry=area.Centroid, Plane=PlaneXY(0, 0, 0))  # -> Geometry, Transform
scale_nu = ScaleNU(Geometry=bbox.Box, Plane=project.Geometry, ScaleX=number_slider, ScaleY=number_slider, ScaleZ=number_slider)  # -> Geometry, Transform

# ----
seggrading = Butterfly_SegmentGrading(percentageLength=panel_2, percentageCells=panel, expansionRatio=1)  # -> segmentGrading; plug-in component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
wall = Butterfly_WallBoundary(refLevels="(1, 4)")  # -> wallBoundary; plug-in component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
multigrading = Butterfly_MultiGrading(segmentGradings=flatten(seggrading))  # -> grading; plug-in component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
wires = BrepWireframe(Brep=scale_nu.Geometry, Density=-1)
inoutrefmode = Butterfly_LocationRefinementMode(mode=0, level="4")  # -> locationRefMode; plug-in component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
jagged = SettingsSpeed()
gradxyz = Butterfly_GradingXYZ(xGrading=1, yGrading=multigrading, zGrading=1)  # -> gradXYZ; plug-in component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
# 0. BUTTERFLY GEOMETRIES
panel_3 = Panel("buildings")
jagged_2 = SettingsSpeed()
createbfgeometry = Butterfly_CreateButterflyGeometry(name=panel_3, geo=flatten(brep), boundary=wall, meshSet=jagged_2)  # -> readMe, BFGeometries; plug-in component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
refinementregion = Butterfly_RefinementRegion(name="between_bldgs", geo=flatten(scale_nu.Geometry), refMode=inoutrefmode, meshSet=jagged)  # -> readMe, refinementRegion; plug-in component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

# ---- group: create test surface in pedestrian level
debrep = DeconstructBrep(Brep=scale_nu.Geometry)  # -> Faces, Edges, Vertices
item = ListItem(List=debrep.Faces, Index=4, Wrap=True)
Z = UnitZ(Factor="1.2")
xy = XYPlane(Origin=Z)
move = Move(Geometry=item, Motion=Z)  # -> Geometry, Transform
wires_2 = BrepWireframe(Brep=move.Geometry, Density=-1)
sec = BrepPlane(Brep=brep, Plane=xy)  # -> Curves, Points
join = JoinCurves(Curves=wires_2, Preserve=False)
boundary = BoundarySurfaces(Edges=flatten([join, sec.Curves]))

# ----
panel_4 = Panel(gradxyz)
meshparams = Butterfly_MeshingParameters(cellSizeXYZ="{5,15,10}", gradXYZ=gradxyz, globRefineLevel="(2, 2)")  # -> readMe, meshPars; plug-in component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
windtunnelpar = Butterfly_WindTunnelParameters(windwardX=3, topX=3, sidesX=2, leewardX=15)  # -> readMe, tunnelPar; plug-in component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
windvector = Butterfly_WindVector(windSpeed="2", windDirection=Point(0, 1, 0))  # -> windVector; plug-in component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

debrep_2 = DeconstructBrep(Brep=scale_nu.Geometry)  # -> Faces, Edges, Vertices
item_2 = ListItem(List=debrep_2.Faces, Index=5, Wrap=True)
area_2 = Area(Geometry=item_2)  # -> Area, Centroid
move_2 = Move(Geometry=area_2.Centroid, Motion=Vector(0, 0, 3))  # -> Geometry, Transform
pt = Point(area_2.Centroid)
tag = TextTag(Location=move_2.Geometry, Text="Refinement Region")

# ----
# 1. WIND TUNNEL
createcasefromtunnel = Butterfly_CreateCaseFromTunnel(
    name="outdoor_airflow",
    BFGeometries=flatten(createbfgeometry.BFGeometries),
    refRegions=refinementregion.refinementRegion,
    windVector=windvector,
    refWindHeight=10,
    landscape=6,
    meshParams=meshparams.meshPars,
    tunnelPar=windtunnelpar.tunnelPar,
    run=Toggle(False))  # -> readMe, pts, case; plug-in component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
pt_2 = Point(createcasefromtunnel.pts)
toggle = BooleanToggle(False)

# ---- group: update inlet wind velocity
panel_5 = Panel("""boundaryField
{

west_window
    {

  
value		uniform (10 0.0 0.0);

}
}""")
panel_6 = Panel("U")

# ----
brep_2 = Brep([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])
brep_3 = Brep(boundary)
# PURGE CASE
purgecase = Butterfly_purgeCase(blockMesh=False, snappyHexMesh=False, results=toggle, postProcessing=toggle)  # -> readMe; plug-in component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
gentestpts = Honeybee_GenerateTestPoints(testGeometry=[brep_3, brep_2], gridSize=Slider(1, range=0..1), distBaseSrf="0.05", moveTestMesh=Toggle(False))  # -> readMe, simplify(testPoints), simplify(ptsVectors), simplify(facesArea), simplify(mesh); plug-in component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

# ---- group: sample the box in 3D
bbox_2 = BoundingBox(Plane=PlaneXY(0, 0, 0), UnionBox=True)  # -> Box, Box_2
range = Range(Domain=Domain(0.05, 0.95), Steps=10)
crossref = CrossReference(ListA=range, ListB=range, ListC=range, CrossMode=1)  # -> ListA, ListB, ListC
box = EvaluateBox(Box=bbox_2.Box, UParameter=crossref.ListA, VParameter=crossref.ListB, WParameter=crossref.ListC)  # -> Plane, Point, Include

# ----
# 2.1. BLOCKMESH
blockmesh = Butterfly_blockMesh(case=createcasefromtunnel.case, overwrite=True, run=Toggle(False))  # -> readMe, case; plug-in component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
panel_7 = Panel("""p
U""")
flatten = FlattenTree(Tree=gentestpts.mesh, Path="{0}")
flatten_2 = FlattenTree(Tree=gentestpts.testPoints, Path="{0}")
controldict = Butterfly_controlDict(startTime=0, endTime=1000, writeInterval=100, writeCompression=False)  # -> controlDict; plug-in component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
probes = Butterfly_probes(pts=flatten_2, fields=panel_7)  # -> probes; plug-in component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
solutionparam = Butterfly_SolutionParameter(filename=panel_6, values=panel_5, replace=False)  # -> solutionParam; plug-in component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
# 2. MESHING
# 2.2. SNAPPYHEXMESH
snappyhexmesh = Butterfly_snappyHexMesh(case=blockmesh.case, run=Toggle(False))  # -> readMe, case; plug-in component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
decomposepardict = Butterfly_decomposeParDict(mode=0, numOfCpus="4")  # -> decomposeParDict; plug-in component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
solutionparams = Butterfly_SolutionParameters(controlDict=controldict, probes=probes, additionalParams=solutionparam)  # -> solutionParams; plug-in component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
steadyincomp = Butterfly_SteadyIncompressibleRecipe()  # -> readMe, recipe; plug-in component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
# VISUALIZE MESH
toggle_2 = BooleanToggle(False)
loadmesh = Butterfly_LoadMesh(case=snappyhexmesh.case, load=toggle_2)  # -> mesh; plug-in component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
# 3. SOLUTION
solution = Butterfly_Solution(
    case=snappyhexmesh.case,
    recipe=steadyincomp.recipe,
    decomposeParDict=decomposepardict,
    solutionParams=solutionparams,
    interval=2,
    write=Toggle(False),
    run=Toggle(False))  # -> readMe, solution, isRunning, timestep, residualFields, residualValues, logFiles; plug-in component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
panel_8 = Panel(solution.readMe)
panel_9 = Panel(solution.residualFields)
panel_10 = Panel(solution.residualValues)
loadprobesvalue = Butterfly_LoadProbesValue(solution=solution.solution, field="p")  # -> values; plug-in component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
loadprobesvalue_2 = Butterfly_LoadProbesValue(solution=solution.solution, field="U")  # -> values; plug-in component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

# ---- group: points
pt_3 = Point(flatten_2)

# ---- group: vectors
vec = Vector(loadprobesvalue_2)

# ----
rec = Rectangle({Plane=PlaneXY(1, -6, 0), Size=Domain2(u=0..15, v=0..5)})
mjoin = MeshJoin(Meshes=flatten)
# PLOT RESIDUALS
plotresiduals = Butterfly_PlotResiduals(solution=solution.solution, rect=rec, targetRes=0.0001, port=0.1, method=0, load=Toggle(False))  # -> readMe, timeRange, curves, port, residualLine, colors; plug-in component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
gradientlibrary = Ladybug_GradientLibrary(gradIndex="7")  # -> customColors; plug-in component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
preview = CustomPreview(Geometry=plotresiduals.curves, Shader=plotresiduals.colors)
panel_11 = Panel(plotresiduals.readMe)
legendpar = Ladybug_LegendParameters(customColors=flatten(gradientlibrary))  # -> legendPar; plug-in component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
# 4. RESULT VISUALIZATION
panel_12 = Panel("273.15")
subtraction = Subtraction(A=loadprobesvalue, B=panel_12)
bnd = Bounds(Numbers=subtraction)
panel_13 = Panel(bnd)
ladybug = Ladybug_Ladybug()  # -> Vviiiiiiiiiizzz; plug-in component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
recolormesh = Ladybug_RecolorMesh(analysisResult=subtraction, inputMesh=mjoin, legendPar=legendpar, analysisTitle="Pressure.", legendTitle="Pa.")  # -> readMe, newMesh, newLegend, legendBasePt, meshColors, legendColors; plug-in component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
scale = Slider(0.44, range=0..1)
faceb = FaceBoundaries(Mesh=recolormesh.newMesh)
mesh = Mesh(recolormesh.newLegend)
multiplication = Multiplication(A=vec, B=scale)
preview_2 = CustomPreview(Geometry=faceb, Shader=recolormesh.meshColors)
vdisex = VectorDisplayEx(Point=pt_3, Vector=multiplication, Colour=ColourSwatch(SwatchColor=RGBA(39, 34, 25, 142)), Width=Slider(2, range=0..5))
